# Grasshopper definition lunchBoxapp.gh (Grasshopper 1.0.7)
# plug-ins: LunchBox

# ----
# Geometry Input
curve = Curve([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])
loft = Loft(Curves=curve, Options={Adjust=False, Closed=False, LoftEnds=0, LoftSimp=0, LoftType=0, Rebuild=10, Refit=0.01})

u_division = GetNumber(Slider(5, range=0..100), AtLeast=1, AtMost=1, Maximum=1.797693135e+308, Minimum=-1.797693135e+308, TreeAccess=False)
v_division = GetNumber(Slider(2, range=0..100), AtLeast=1, AtMost=1, Maximum=1.797693135e+308, Minimum=-1.797693135e+308, TreeAccess=False)
truss_depth = GetNumber(Slider(3, range=0..10), AtLeast=1, AtMost=1, Maximum=1.797693135e+308, Minimum=-1.797693135e+308, TreeAccess=False)
negative = Negative(Value=truss_depth)
space_truss_structure_1 = SpaceTrussStructure1(Surface=loft, UDivisions=u_division, VDivisions=v_division, TrussDepth=negative)  # -> PrimaryLines, PrimaryLines_2, WebLines, StructureNodes
project_along = ProjectAlong(Geometry=loft, Plane=PlaneXY(0, 0, 0), Direction=Vector(0, 0, -1))  # -> Geometry, Transform

# ----
# Data Calculations
list_length = ListLength(List=[space_truss_structure_1.PrimaryLines, space_truss_structure_1.PrimaryLines_2])
list_length_2 = ListLength(List=space_truss_structure_1.WebLines)
panel = Panel(list_length)
panel_2 = Panel(list_length_2)
area = Area(Geometry=project_along.Geometry)  # -> Area, Centroid
multiplication = Multiplication(A=list_length, B="23.7")

diagonals = GetNumber(Slider(1, range=0..1), AtLeast=1, AtMost=1, Maximum=1.797693135e+308, Minimum=-1.797693135e+308, TreeAccess=False)
truss_lines = GetNumber(Slider(0.2, range=0..1), AtLeast=1, AtMost=1, Maximum=1.797693135e+308, Minimum=-1.797693135e+308, TreeAccess=False)
pipe = Pipe(Curve=space_truss_structure_1.PrimaryLines_2, Radius=truss_lines, Caps=0)  # -> flatten(Pipe)
pipe_2 = Pipe(Curve=space_truss_structure_1.WebLines, Radius=diagonals, Caps=0)  # -> flatten(Pipe)
pipe_3 = Pipe(Curve=space_truss_structure_1.PrimaryLines, Radius=diagonals, Caps=0)  # -> flatten(Pipe)
# Person Geometry
mesh = Mesh(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)

# ----
# Geometry output
mesh_join = MeshJoin(Meshes=[pipe_2, pipe, pipe_3, mesh])  # -> flatten(Mesh)
mesh_2 = Mesh(flatten(mesh_join))
context_bake = ContextBake(Geometry=mesh_2)

context_print = ContextPrint(ContextPrint=panel)
cost = ContextPrint(Text=area.Area)
diagonals_2 = ContextPrint(Diagonals=panel_2)
# Data output
area_2 = ContextPrint(Text=multiplication)
