# Grasshopper definition sample_box_grasshopper.gh (Grasshopper 1.0.7)

width = GetNumber(Slider(3, range=0..20), AtLeast=1, AtMost=1, Maximum=1.797693135e+308, Minimum=-1.797693135e+308, TreeAccess=False)
length = GetNumber(Slider(4, range=0..20), AtLeast=1, AtMost=1, Maximum=1.797693135e+308, Minimum=-1.797693135e+308, TreeAccess=False)
height = GetNumber(Slider(5, range=0..20), AtLeast=1, AtMost=1, Maximum=1.797693135e+308, Minimum=-1.797693135e+308, TreeAccess=False)
box = CenterBox(Base=PlaneXY(0, 0, 0), X=width, Y=length, Z=height)
mesh = Mesh(box)
context_bake = ContextBake(Geometry=mesh)
python_write_text_file = GhPythonScript()  # -> out, a
# ---------- python_write_text_file: Python ----------
__author__ = "VIKTOR"
__version__ = "2022.03.28"

import rhinoscriptsyntax as rs

with open(file_path, 'w') as textfile:
    textfile.write('{}\n'.format(amount_of_seats))
    textfile.write('{}\n'.format(width))
    textfile.write('{}\n'.format(length))
# ---------- end python_write_text_file ----------
